# Grasshopper definition m-06.gh (Grasshopper 0.9.76)
# plug-ins: Python Interpreter, HDTReference

file_path = FilePath("C:\Users\danil\Documents\GitHub\gda\dummy data\d-11 Team assignment data.pkl")
file_path_2 = FilePath("C:\Users\danil\Documents\GitHub\gda\dummy data\d-10 graph data.pkl")
file_path_3 = FilePath("C:\Users\danil\Documents\GitHub\gda\data\-team_data.json")
file_path_4 = FilePath("C:\Users\danil\Documents\GitHub\gda\dummy data\d-09 neighborhood data.pkl")
python = PythonScript(x=file_path)  # -> a
# ---------- python: Python ----------
import pickle

data = pickle.load( open(x, 'rb') )

print data

a = pickle.dumps(data)
# ---------- end python ----------
python_2 = PythonScript(x=file_path_2)  # -> a
# ---------- python_2: Python ----------
import pickle

data = pickle.load( open(x, 'rb') )

a = pickle.dumps(data)
# ---------- end python_2 ----------
python_3 = PythonScript(x=file_path_4)  # -> a
# ---------- python_3: Python ----------
import pickle

data = pickle.load( open(x, 'rb') )

a = pickle.dumps(data["amenities"])
# ---------- end python_3 ----------
python_4 = PythonScript()  # -> path
# ---------- python_4: Python ----------
import pickle

path = ghenv.LocalScope.ghdoc.Path
path = path.split("\\")
path = "\\".join(path[:-3]) + "\\python resources"
# ---------- end python_4 ----------
dijkstra = PythonScript(resource_path=python_4, a_data=python_3, g=python_2, t=python, t_pref=file_path_3)  # -> out, a
# ---------- dijkstra: Python ----------
from __future__ import generators
import pickle
import json

import sys
sys.path.append(resource_path)
from dijkstra import shortestPath

graph = pickle.loads(g)
am_data = pickle.loads(a_data)
team_data = pickle.loads(t)

with open(t_pref, 'r') as f:
    team_pref = json.load(f)

print team_pref

start = team_data[team_pref.keys()[0]][1]
end = team_data[team_pref[team_pref.keys()[0]]['adjacency-teams'][1][0]][1]



a = shortestPath(graph["edges"], start, end)
# ---------- end dijkstra ----------
python_5 = PythonScript(g=python_2, seq=dijkstra.a)  # -> out, pts; inputs seq: list
# ---------- python_5: Python ----------
from __future__ import generators
import pickle
import rhinoscriptsyntax as rs

graph = pickle.loads(g)

pts = []

for s in seq:
    pts.append(rs.AddPoint(graph["nodes"][s]["coords"]))
# ---------- end python_5 ----------
pline = PolyLine(Vertices=python_5.pts, Closed=False)
previewlw = CustomPreviewLineweights(
    Geometry=pline,
    Shader={ambient=RGB(0, 0, 0), diffuse=RGB(255, 105, 180), emission=RGB(76, 32, 54), shine=0.5, specular=RGB(255, 255, 255), transparency=0},
    Thickness=Slider(7.8, range=0..10))
